# Grasshopper definition DDS_leverage.gh (Grasshopper 1.0.7)
# plug-ins: MarchingCubes, Kangaroo2 Components

construct_point = ConstructPoint(XCoordinate=0, YCoordinate=0, ZCoordinate=0)
number_slider = Slider(1000, range=0..1000)

# ----
# ORBIT 2
circle = Circle(Plane=construct_point, Radius=number_slider)

end_points = EndPoints(Curve=circle)  # -> Start, End
circle_2 = Circle(Plane=end_points.Start, Radius=number_slider)

# ----
# ORBIT 1
circle_3 = Circle(Plane=end_points.Start, Radius=Slider(100, range=0..100))

number_slider_2 = Slider(0, range=0..3600)
number_slider_3 = Slider(0, range=0..1000)
number_slider_4 = Slider(1081, range=0..3240)
divide_curve = DivideCurve(Curve=circle_2, Count=Slider(360, range=0..1000), Kinks=False)  # -> Points, Tangents, Parameters
number_slider_5 = Slider(3240, range=1081..3240)
panel = Panel("""2159
1.5 TUR OLSUN ÖBÜRÜ""")
divide_curve_2 = DivideCurve(Curve=circle_3, Count=Slider(4, range=0..10), Kinks=False)  # -> Points, Tangents, Parameters

# ----
# SUN
number_slider_6 = Slider(150, range=0..1000)
list_item = ListItem(List=divide_curve.Points, Index=expr("x/6", number_slider_5), Wrap=True)
sphere = Sphere(Base=list_item, Radius=number_slider_6)
custom_preview = CustomPreview(Geometry=sphere, Material=ColourSwatch(SwatchColor=RGB(255, 255, 114)))

division = Division(A=number_slider_5, B="2")

# ----
# merkez noktalar
point = Point(divide_curve_2.Points)

sphere_2 = Sphere(Base=point, Radius=Slider(50, range=0..100))
scale = Scale(Geometry=sphere_2, Center=point, Factor=Slider(0.8, range=0..1))  # -> Geometry, Transform
list_item_2 = ListItem(List=scale.Geometry, Index=0, Wrap=True)  # -> Item, Item1, Item2, Item3
list_item_3 = ListItem(List=point, Index=0, Wrap=True)  # -> Item, Item1, Item2, Item3
brep = Brep(list_item_2.Item)
random = Random(Range="[20,40]", Number="1", Seed=Slider(1, range=1..10), Integers=True)
random_2 = Random(Range="[20,40]", Number="1", Seed=Slider(6, range=1..10), Integers=True)
random_3 = Random(Range="[20,40]", Number="1", Seed=Slider(7, range=1..10), Integers=True)
populate_3d = Populate3D(Region=brep, Count=random, Seed=Slider(0, range=0..10))
random_4 = Random(Range="[20,40]", Number="1", Seed=Slider(2, range=1..10), Integers=True)
brep_2 = Brep(list_item_2.Item1)
brep_3 = Brep(list_item_2.Item3)
brep_4 = Brep(list_item_2.Item2)
populate_3d_2 = Populate3D(Region=brep_3, Count=random_2, Seed=Slider(3, range=0..10))
point_in_brep = PointInBrep(Brep=brep, Point=populate_3d, Strict=False)
populate_3d_3 = Populate3D(Region=brep_2, Count=random_4, Seed=Slider(1, range=0..10))
populate_3d_4 = Populate3D(Region=brep_4, Count=random_3, Seed=Slider(2, range=0..10))
cull_pattern = CullPattern(List=populate_3d, CullPattern=point_in_brep)
point_in_brep_2 = PointInBrep(Brep=brep_3, Point=populate_3d_2, Strict=False)
point_in_brep_3 = PointInBrep(Brep=brep_2, Point=populate_3d_3, Strict=False)
point_in_brep_4 = PointInBrep(Brep=brep_4, Point=populate_3d_4, Strict=False)
cull_pattern_2 = CullPattern(List=populate_3d_2, CullPattern=point_in_brep_2)
cull_pattern_3 = CullPattern(List=populate_3d_3, CullPattern=point_in_brep_3)
cull_pattern_4 = CullPattern(List=populate_3d_4, CullPattern=point_in_brep_4)
gezegen_merkezi̇ = Point(end_points.Start)
vector_2pt = Vector2Pt(PointA=gezegen_merkezi̇, PointB=list_item_3.Item, Unitize=False)  # -> Vector, Length
vector_2pt_2 = Vector2Pt(PointA=gezegen_merkezi̇, PointB=list_item_3.Item3, Unitize=False)  # -> Vector, Length
rotate_3d = Rotate3D(Geometry=cull_pattern, Angle=degrees(number_slider_5), Center=list_item_3.Item, Axis=vector_2pt.Vector)  # -> Geometry, Transform
vector_2pt_3 = Vector2Pt(PointA=gezegen_merkezi̇, PointB=list_item_3.Item1, Unitize=False)  # -> Vector, Length
vector_2pt_4 = Vector2Pt(PointA=gezegen_merkezi̇, PointB=list_item_3.Item2, Unitize=False)  # -> Vector, Length
rotate_3d_2 = Rotate3D(Geometry=cull_pattern_3, Angle=degrees(number_slider_5), Center=list_item_3.Item1, Axis=vector_2pt_3.Vector)  # -> Geometry, Transform
rotate_3d_3 = Rotate3D(Geometry=cull_pattern_4, Angle=degrees(number_slider_5), Center=list_item_3.Item2, Axis=vector_2pt_4.Vector)  # -> Geometry, Transform
rotate_3d_4 = Rotate3D(Geometry=cull_pattern_2, Angle=degrees(number_slider_5), Center=list_item_3.Item3, Axis=vector_2pt_2.Vector)  # -> Geometry, Transform
number_slider_7 = Slider(97, range=0..100)

point_2 = Point(rotate_3d_4.Geometry)
water = Point(rotate_3d_2.Geometry)
point_3 = Point(rotate_3d_3.Geometry)
point_4 = Point(rotate_3d.Geometry)

sun = Point(list_item)
unit_z = UnitZ(Factor=Slider(115, range=0..1000))
random_5 = Random(Range="[80,100]", Number=1, Seed=Slider(1, range=0..10))
list_length = ListLength(List=point_4)
random_6 = Random(Range=list_length, Number=1, Seed=Slider(1, range=0..10))
ghpython_script = GhPythonScript(
    air=point_4,
    water=rotate_3d_2.Geometry,
    earth=point_3,
    fire=point_2,
    degree=division,
    sun=sun,
    planet_center=gezegen_merkezi̇,
    effecting_dist=Slider(40, range=0..100),
    f_d=Slider(90, range=0..100),
    x=Slider(2, range=0..8),
    att2_degree=Slider(90, range=0..100))  # -> out, air_normal, water_normal, earth_normal, fire_normal, air_effected_a, water_effected_a, earth_effected_a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; inputs air: list, water: list, earth: list, fire: list, degree: Int32, x: Int32, att2_degree: Int32
# ---------- ghpython_script: Python ----------
__author__ = "seyma"
__version__ = "2022.01.24"

import rhinoscriptsyntax as rs
import math
import random as rnd

air_all=rs.coerce3dpointlist(air)
water_all=rs.coerce3dpointlist(water)
earth_all=rs.coerce3dpointlist(earth)
fire_all=rs.coerce3dpointlist(fire)
planet_center=rs.coerce3dpoint(planet_center)

def dist(p1, p2):
    return math.sqrt((p1[0] - p2[0]) **2+
                     (p1[1] - p2[1]) **2+
                     (p1[2] - p2[2])**2)

def closest(pt,pt_list):
    closest_index=1000
    min_dist=10000
    for i in range(len(pt_list)):
        c_dist=dist(pt_list[i],pt)
        if c_dist<min_dist:
            min_dist=c_dist
            closest_index=i
    if closest_index!=1000:
        return pt_list[closest_index] 
    else:None


att_dict={}
att_air=[]
att_water=[]
att_earth=[]
att_fire=[]

##first attractor##
##att_numarası grasshopperdan gelsin herr sefrerinde yeniden random alıyordu#
att_0=air_all[x]
if degree>0:
    att_1=air_all[x]
    air_all.remove(att_1)
    att_1=rs.RotateObject(att_1,planet_center,degree)
    att_1=rs.coerce3dpoint(att_1)
    att_dict[att_1]=["air"]

#f_d=following distance
if degree>att2_degree+f_d:
    """att1_att2_creation_p=rs.RotateObject(att_0,planet_center,att2_degree)
    att1_att2_creation_p=rs.coerce3dpoint(att1_att2_creation_p)
    att_2=closest(att1_att2_creation_p,water_all)"""
    att_2=water_all[x]
    water_all.remove(att_2)
    att_2=rs.RotateObject(att_2,planet_center,degree-att2_degree-f_d)
    att_2=rs.coerce3dpoint(att_2)
    att_dict[att_2]=["water"]
if degree>90+att2_degree+f_d*2:
    """att1_att3_creation_p=rs.RotateObject(att_0,planet_center,90)
    att1_att3_creation_p=rs.coerce3dpoint(att1_att3_creation_p)
    att_3=closest(att1_att3_creation_p,earth_all)"""
    att_3=earth_all[x]
    earth_all.remove(att_3)
    att_3=rs.RotateObject(att_3,planet_center,degree-att2_degree-2*f_d-90)
    att_3=rs.coerce3dpoint(att_3)
    att_dict[att_3]=["earth"]
if degree>180+att2_degree+f_d*3:
    """att1_att4_creation_p=rs.RotateObject(att_0,planet_center,180)
    att1_att4_creation_p=rs.coerce3dpoint(att1_att4_creation_p)
    att_4=closest(att1_att4_creation_p,fire_all)"""
    att_4=fire_all[x]
    fire_all.remove(att_4)
    att_4=rs.RotateObject(att_4,planet_center,degree-att2_degree-3*f_d-180)
    att_4=rs.coerce3dpoint(att_4)
    att_dict[att_4]=["fire"]


att_list=att_dict.keys()
att_list=rs.coerce3dpointlist(att_list)
print len(att_list)
for att in att_list:
    if att_dict[att][0]=="air":att_air.append(att)
    elif att_dict[att][0]=="water":att_water.append(att)
    elif att_dict[att][0]=="earth":att_earth.append(att)
    elif att_dict[att][0]=="fire":att_fire.append(att)




####


###
air_normal=[]
water_normal=[]
earth_normal=[]
fire_normal=[]

air_effected_a=[]
water_effected_a=[]
earth_effected_a=[]
fire_effected_a=[]

air_effected_w=[]
water_effected_w=[]
earth_effected_w=[]
fire_effected_w=[]

air_effected_e=[]
water_effected_e=[]
earth_effected_e=[]
fire_effected_e=[]

air_effected_f=[]
water_effected_f=[]
earth_effected_f=[]
fire_effected_f=[]


for airs in air_all:
    closest_att=closest(airs,att_list)
    if closest_att!=None:
        if dist(airs,closest_att)<40: ##değişebilir
            if att_dict[closest_att][0]=="air":
                air_effected_a.append(airs)
            elif att_dict[closest_att][0]=="water":
                air_effected_w.append(airs)
            elif att_dict[closest_att][0]=="earth":
                air_effected_e.append(airs)
            elif att_dict[closest_att][0]=="fire":
                air_effected_f.append(airs)
        else:air_normal.append(airs)
    else:air_normal.append(airs)
    

for waters in water_all:
    closest_att=closest(waters,att_list)
    if closest_att!=None:
        if dist(waters,closest_att)<40: ##değişebilir
            if att_dict[closest_att][0]=="air":
                water_effected_a.append(waters)
            elif att_dict[closest_att][0]=="water":
                water_effected_w.append(waters)
            elif att_dict[closest_att][0]=="earth":
                water_effected_e.append(waters)
            elif att_dict[closest_att][0]=="fire":
                water_effected_f.append(waters)
        else:water_normal.append(waters)
    else:water_normal.append(waters)
for earths in earth_all:
    closest_att=closest(earths,att_list)
    if closest_att!=None:
        if dist(earths,closest_att)<40: ##değişebilir
            if att_dict[closest_att][0]=="air":
                earth_effected_a.append(earths)
            elif att_dict[closest_att][0]=="water":
                earth_effected_w.append(earths)
            elif att_dict[closest_att][0]=="earth":
                earth_effected_e.append(earths)
            elif att_dict[closest_att][0]=="fire":
                earth_effected_f.append(earths)
        else:earth_normal.append(earths)
    else:earth_normal.append(earths)

for fires in fire_all:
    closest_att=closest(fires,att_list)
    if closest_att!=None:
        if dist(fires,closest_att)<40: ##değişebilir
            if att_dict[closest_att][0]=="air":
                fire_effected_a.append(fires)
            elif att_dict[closest_att][0]=="water":
                fire_effected_w.append(fires)
            elif att_dict[closest_att][0]=="earth":
                fire_effected_e.append(fires)
            elif att_dict[closest_att][0]=="fire":
                fire_effected_f.append(fires)
        else:fire_normal.append(fires)
    else:fire_normal.append(fires)


"""        
for i in range(time):
    rs.RotateObjects(air_all,center_air,i,Y_axis)
##tur bitince 

def total_dist(point1,p_list):
    for point1 in p_list:
        dist_toplam=0
        for point2 in p_list:
            dist_toplam+=dist(point1,point2)
    return dist_toplam

##att finding
min_total_dist=1000
index=1000
for i in range(len(air_all)):
    current_td=total_dist(air_all[i],air_all)
    print current_td
    if current_td<min_total_dist:
        min_total_dist=current_td
        index=i
    else:pass
print min_total_dist
print i
        
att_dict={}


#for i in range(time):"""
# ---------- end ghpython_script ----------
point_5 = Point(ghpython_script.att_water)
vector_2pt_5 = Vector2Pt(PointA=point_5, PointB=gezegen_merkezi̇, Unitize=False)  # -> expr("1.5*x", Vector), Length
move = Move(Geometry=gezegen_merkezi̇, Motion=vector_2pt_5.Vector)  # -> Geometry, Transform
# AIR
# if len(effected_list)>0:
# +effected_list.append(att)
# 
# WATER
# if len(effected_list)>0:
# r_att-=0.01
# r_water=k*r
# k=dist=40-0 remap=>4-1
# +yakın olanın kristali daha çok çekilir.
# -rengi değişsin att öesafesine göre
# -att etkiledikçe küçülür
# 
# EARTH
# field lines=len(effecgted_list)*100
# filedı etkileyenler de o mesafedeki
# EFFCTERDELRİN RADİUSU KÜÇÜK MESAFESİNE GÖRE
# 
# water-FİRE ı bir daha düşünnn
# earth air eşleştirmesinde odak notkata değişse
move_2 = Move(Geometry=move.Geometry, Motion=unit_z)  # -> Geometry, Transform
ghpython_script_2 = GhPythonScript(cam_loc=move_2.Geometry, target=point_5)  # -> out, a
# ---------- ghpython_script_2: Python ----------
__author__ = "seyma"
__version__ = "2022.01.12"

import rhinoscriptsyntax as rs
import scriptcontext as sc

sc.doc=ghdoc
loc=rs.coerce3dpoint(cam_loc)
target=rs.coerce3dpoint(target)


vp=sc.doc.Views.ActiveView.ActiveViewport
vp.SetCameraLocation(loc,False)
vp.SetCameraDirection(target - loc, True)
# ---------- end ghpython_script_2 ----------
fire_effected_f = Point(ghpython_script.fire_effected_f)
earth_effected_w = Point(ghpython_script.earth_effected_w)
earth_effected_e = Point(ghpython_script.earth_effected_e)
air_effected_f = Point(ghpython_script.air_effected_f)
water_effected_e = Point(ghpython_script.water_effected_e)
water_effected_w = Point(ghpython_script.water_effected_w)

distance = Distance(PointA=[earth_effected_w, earth_effected_e], PointB=sun)
remap_numbers = RemapNumbers(Value=distance, Source="[850,1150]", Target="[6,15]")  # -> expr("1.8*x", Mapped), Clipped

distance_2 = Distance(PointA=[water_effected_w, water_effected_e], PointB=sun)
remap_numbers_2 = RemapNumbers(Value=distance_2, Source="[850,1150]", Target="[6,15]")  # -> expr("2*x", Mapped), Clipped

earth_affected_a = Point(ghpython_script.earth_effected_a)
att = Point(ghpython_script.att_air)
fire_effected_w = Point(ghpython_script.fire_effected_w)
att_water = Point(ghpython_script.att_water)
unit_y = UnitY(Factor=1)
unit_z_2 = UnitZ(Factor=1)
point_6 = Point(flatten([water_effected_w, earth_effected_w]))
move_3 = Move(Geometry=att_water, Motion=unit_y)  # -> Geometry, Transform
move_4 = Move(Geometry=att_water, Motion=unit_z_2)  # -> Geometry, Transform; disabled

plane_3pt = Plane3Pt(PointA=att_water, PointB=[move_3.Geometry, move_4.Geometry], PointC=sun)  # -> graft(Plane)
deconstruct_plane = DeconstructPlane(Plane=plane_3pt)  # -> Origin, XAxis, YAxis, ZAxis
series = Series(Start=Slider(0, range=0..100), Step=Slider(0.5, range=0..1), Count=Slider(60, range=0..100))
unit_vector = UnitVector(Vector=deconstruct_plane.ZAxis)
multiplication = Multiplication(A=unit_vector, B=series)
move_5 = Move(Geometry=plane_3pt, Motion=multiplication)  # -> Geometry, Transform
mirror = Mirror(Geometry=move_5.Geometry, Plane=plane_3pt)  # -> Geometry, Transform

series_2 = Series(Start=0, Step=Slider(1, range=0..10), Count=Slider(50, range=0..100))
xy_plane = XYPlane(Origin=Point(0, 0, 0))
unit_z_3 = UnitZ(Factor=series_2)
move_6 = Move(Geometry=xy_plane, Motion=unit_z_3)  # -> Geometry, Transform
mirror_2 = Mirror(Geometry=move_6.Geometry, Plane=xy_plane)  # -> Geometry, Transform
point_7 = Point(flatten([water_effected_e, earth_effected_e]))
water_effected_f = Point(ghpython_script.water_effected_f)
earth_effected_f = Point(ghpython_script.earth_effected_f)
att_fire = Point(ghpython_script.att_fire)
point_8 = Point(flatten([air_effected_f, fire_effected_f]))
earth_effected_f_2 = Point(ghpython_script.earth_effected_f)
point_9 = Point(flatten([water_effected_f, earth_effected_f_2]))
ghpython_script_3 = GhPythonScript(affected_lists_pos=point_8, affected_lists_neg=point_9)  # -> out, r_current; inputs affected_lists_pos: list, affected_lists_neg: list
# ---------- ghpython_script_3: Python ----------
__author__ = "seyma"
__version__ = "2022.01.22"

import rhinoscriptsyntax as rs

r0=20
if affected_lists_pos!=None:pos=len(affected_lists_pos)
else: pos=0
if affected_lists_neg!=None:neg=len(affected_lists_neg)
else:neg=0

r_current=r0+pos-neg
print r_current
# ---------- end ghpython_script_3 ----------
line = Line(StartPoint=att_fire, EndPoint=[point_8, earth_effected_f])

list_item_4 = ListItem(List=flatten(water_effected_f), Index=0, Wrap=True)  # -> Item, Item1, Item2
plane_3pt_2 = Plane3Pt(PointA=list_item_4.Item, PointB=list_item_4.Item2, PointC=sun)
deconstruct_plane_2 = DeconstructPlane(Plane=plane_3pt_2)  # -> Origin, XAxis, YAxis, ZAxis
series_3 = Series(Start=Slider(0, range=0..100), Step=Slider(4, range=0..10), Count=Slider(50, range=0..100))
unit_vector_2 = UnitVector(Vector=deconstruct_plane_2.ZAxis)
multiplication_2 = Multiplication(A=unit_vector_2, B=series_3)
move_7 = Move(Geometry=plane_3pt_2, Motion=multiplication_2)  # -> Geometry, Transform
mirror_3 = Mirror(Geometry=move_7.Geometry, Plane=plane_3pt_2)  # -> Geometry, Transform

panel_2 = Panel(ghpython_script_3.r_current)
distance_3 = Distance(PointA=water_effected_f, PointB=att_fire)
remap_numbers_3 = RemapNumbers(Value=distance_3, Source="[0,40]", Target="[20,3]")  # -> Mapped, Clipped
number_slider_8 = Slider(0.1, range=0..1)

# ----
# NORMAL FIRE
fire_affected_a = Point(ghpython_script.fire_effected_a)
fire_normal = Point(ghpython_script.fire_normal)
point_10 = Point(flatten([fire_normal, fire_affected_a, fire_effected_f]))
distance_4 = Distance(PointA=fire_normal, PointB=sun)
distance_5 = Distance(PointA=[fire_affected_a, fire_effected_f], PointB=sun)
number_slider_9 = Slider(0.3, range=0..1)
remap_numbers_4 = RemapNumbers(Value=distance_4, Source="[850,1150]", Target="[9,22.5]")  # -> Mapped, Clipped
point_charge_maın_fire = PointCharge(Point=graft(fire_normal), Radius=remap_numbers_4.Mapped, ChargeStrength=number_slider_9)
gradient = Gradient(
    LowerLimit="850",
    UpperLimit="1150",
    Parameter=[distance_4, distance_5],
    stops=[0.152: RGB(255, 192, 128), 0.854: RGB(192, 64, 0)])
create_material = CreateMaterial(Diffuse=gradient, Specular=RGB(255, 255, 255), Emission=RGB(0, 0, 0), Transparency=Slider(0.93, range=0..1), Shine=0)

remap_numbers_5 = RemapNumbers(Value=distance_5, Source="[850,1150]", Target="[9,22.5]")  # -> expr("2*x", Mapped), Clipped
point_charge_maın_fire_2 = PointCharge(Point=graft([fire_affected_a, fire_effected_f]), Radius=remap_numbers_5.Mapped, ChargeStrength=number_slider_9)

cocoon = Cocoon(
    Charges=flatten([point_charge_maın_fire, point_charge_maın_fire_2]),
    Iso=Slider(0.17, range=0..1),
    CellSize=Slider(8, range=0..10),
    Execute=True,
    Simple=False)  # -> Mesh, RefinementData
populate_geometry = PopulateGeometry(Geometry=cocoon.Mesh, Count=expr("4*x", [remap_numbers_4.Mapped, remap_numbers_5.Mapped]), Seed=1)
delaunay_edges = DelaunayEdges(Points=populate_geometry, Plane=PlaneXY(0, 0, 0))  # -> Connectivity, Edges
curve_middle = CurveMiddle(Curve=delaunay_edges.Edges)
distance_6 = Distance(PointA=curve_middle, PointB=sun)
gradient_2 = Gradient(LowerLimit="850", UpperLimit="1150", Parameter=distance_6, stops=[0.152: RGB(255, 192, 128), 0.854: RGB(192, 64, 0)])
custom_preview_2 = CustomPreview(Geometry=delaunay_edges.Edges, Material=gradient_2)
custom_preview_3 = CustomPreview(Geometry=cocoon.Mesh, Material=create_material)

# ----
# NORMAL EARTH
earth_normal = Point(ghpython_script.earth_normal)
distance_7 = Distance(PointA=earth_normal, PointB=sun)
remap_numbers_6 = RemapNumbers(Value=distance_7, Source="[850,1150]", Target="[6,15]")  # -> Mapped, Clipped
gradient_3 = Gradient(
    LowerLimit="850",
    UpperLimit="1150",
    Parameter=[distance_7, distance],
    stops=[0.142: RGB(192, 255, 192), 0.85: RGB(0, 128, 0)])

point_11 = Point([earth_normal, earth_effected_w, earth_effected_e])

sphere_3 = Sphere(Base=point_11, Radius=[remap_numbers_6.Mapped, remap_numbers.Mapped])
custom_preview_4 = CustomPreview(Geometry=sphere_3, Material=gradient_3)

# ----
# NORMAL AIR
air_affected_a = Point(ghpython_script.air_effected_a)
air_normal = Point(ghpython_script.air_normal)
distance_8 = Distance(PointA=air_normal, PointB=sun)
point_12 = Point([air_normal, air_affected_a, air_effected_f])
remap_numbers_7 = RemapNumbers(Value=distance_8, Source="[850,1150]", Target="[6,15]")  # -> Mapped, Clipped
gradient_4 = Gradient(LowerLimit="850", UpperLimit="1150", Parameter=distance_8, stops=[0.151: RGB(255, 128, 255), 0.851: RGB(128, 0, 128)])
gradient_5 = Gradient(LowerLimit="850", UpperLimit="1150", Parameter=distance_8, stops=[0.151: RGB(255, 128, 255), 0.851: RGB(128, 0, 128)])
create_material_2 = CreateMaterial(Diffuse=gradient_4, Specular=RGB(255, 255, 255), Emission=RGB(0, 0, 0), Transparency=Slider(0.88, range=0..1), Shine=0)

# ----
# AIR-AIR-DOUBLESİZE
distance_9 = Distance(PointA=[air_affected_a, air_effected_f], PointB=sun)
remap_numbers_8 = RemapNumbers(Value=distance_9, Source="[850,1150]", Target="[6,15]")  # -> expr("2*x", Mapped), Clipped

sphere_4 = Sphere(Base=point_12, Radius=[remap_numbers_7.Mapped, remap_numbers_8.Mapped])
populate_geometry_2 = PopulateGeometry(Geometry=sphere_4, Count=expr("3*x", remap_numbers_7.Mapped), Seed=1)
delaunay_edges_2 = DelaunayEdges(Points=flatten(populate_geometry_2), Plane=PlaneXY(0, 0, 0))  # -> Connectivity, Edges
delaunay_mesh = DelaunayMesh(Points=populate_geometry_2, Plane=PlaneXY(0, 0, 0))
custom_preview_5 = CustomPreview(Geometry=delaunay_edges_2.Edges, Material=gradient_5)
custom_preview_6 = CustomPreview(Geometry=delaunay_mesh, Material=create_material_2)
dot_display = DotDisplay(Point=populate_geometry_2, Colour=ColourSwatch(SwatchColor=RGB(255, 255, 255)), Size=Slider(0.8, range=0..1))

# ----
# NORMAL WATER
water_normal = Point(ghpython_script.water_normal)
distance_10 = Distance(PointA=water_normal, PointB=sun)
remap_numbers_9 = RemapNumbers(Value=distance_10, Source="[850,1150]", Target="[6,15]")  # -> Mapped, Clipped
number_slider_10 = Slider(44, range=0..100)

point_13 = Point([water_normal, water_effected_w, water_effected_e])

sphere_5 = Sphere(Base=point_13, Radius=[remap_numbers_9.Mapped, remap_numbers_2.Mapped])
populate_3d_5 = Populate3D(Region=sphere_5, Count=expr("4*x", [remap_numbers_9.Mapped, remap_numbers_2.Mapped]), Seed=Slider(4, range=0..10))
point_in_breps = PointInBreps(Brep=sphere_5, Point=populate_3d_5, Strict=False)  # -> Inside, Index
cull_pattern_5 = CullPattern(List=populate_3d_5, CullPattern=point_in_breps.Inside)
dot_display_2 = DotDisplay(Point=cull_pattern_5, Colour=ColourSwatch(SwatchColor=RGB(255, 255, 255)), Size=Slider(0.8, range=0..1))

list_item_5 = ListItem(List=flatten([point_13, populate_3d_5]), Index=0, Wrap=True)  # -> Item, Item1, Item2
plane_3pt_3 = Plane3Pt(PointA=list_item_5.Item, PointB=list_item_5.Item2, PointC=sun)
deconstruct_plane_3 = DeconstructPlane(Plane=plane_3pt_3)  # -> Origin, XAxis, YAxis, ZAxis
series_4 = Series(Start=Slider(0, range=0..100), Step=Slider(2, range=0..10), Count=Slider(50, range=0..100))
unit_vector_3 = UnitVector(Vector=deconstruct_plane_3.ZAxis)
multiplication_3 = Multiplication(A=unit_vector_3, B=series_4)
move_8 = Move(Geometry=plane_3pt_3, Motion=multiplication_3)  # -> Geometry, Transform
mirror_4 = Mirror(Geometry=move_8.Geometry, Plane=plane_3pt_3)  # -> Geometry, Transform

metaball_t = MetaBallT(Points=flatten(cull_pattern_5), Plane=[mirror_4.Geometry, move_8.Geometry], Threshold=Slider(0.36, range=0..1))
length = Length(Curve=metaball_t)
bounds = Bounds(Numbers=length)
remap_numbers_10 = RemapNumbers(Value=length, Source=bounds, Target=Domain(0, 1))  # -> Mapped, Clipped
gradient_6 = Gradient(
    LowerLimit=0,
    UpperLimit=1,
    Parameter=remap_numbers_10.Mapped,
    stops=[0.149: RGB(192, 255, 255), 0.848: RGB(0, 128, 128)])
custom_preview_7 = CustomPreview(Geometry=metaball_t, Material=gradient_6)

point_14 = Point(flatten([air_affected_a, fire_affected_a]))
# AIR ATT
number_slider_11 = Slider(0.8, range=0..1)

# ----
# EARTH-AIR
earth_affected_a_2 = Point(ghpython_script.earth_effected_a)
distance_11 = Distance(PointA=earth_affected_a_2, PointB=sun)
remap_numbers_11 = RemapNumbers(Value=distance_11, Source="[850,1150]", Target="[6,15]")  # -> Mapped, Clipped
gradient_7 = Gradient(LowerLimit="850", UpperLimit="1150", Parameter=distance_11, stops=[0.142: RGB(192, 255, 192), 0.85: RGB(0, 128, 0)])

sphere_6 = Sphere(Base=earth_affected_a_2, Radius=remap_numbers_11.Mapped)

# ----
# WATER-AIR
water_affected_a = Point(ghpython_script.water_effected_a)
distance_12 = Distance(PointA=water_affected_a, PointB=att)
remap_numbers_12 = RemapNumbers(Value=distance_12, Source="[0,40]", Target="[6,0]")  # -> graft(Mapped), Clipped
colour_swatch = ColourSwatch(SwatchColor=RGB(255, 255, 255))

point_15 = Point(flatten([water_affected_a, earth_affected_a_2]))
ghpython_script_4 = GhPythonScript(affected_lists_pos=point_14, affected_lists_neg=point_15)  # -> out, r_current; inputs affected_lists_pos: list, affected_lists_neg: list
# ---------- ghpython_script_4: Python ----------
__author__ = "seyma"
__version__ = "2022.01.22"

import rhinoscriptsyntax as rs

r0=10
if affected_lists_pos!=None:pos=len(affected_lists_pos)
else: pos=0
if affected_lists_neg!=None:neg=len(affected_lists_neg)
else:neg=0

r_current=r0+pos/2-neg/2
print r_current
# ---------- end ghpython_script_4 ----------
sphere_7 = Sphere(Base=att, Radius=ghpython_script_4.r_current)
panel_3 = Panel(ghpython_script_4.r_current)
populate_geometry_3 = PopulateGeometry(Geometry=sphere_7, Count=expr("3*x", ghpython_script_4.r_current), Seed=1)
point_16 = Point(flatten([populate_geometry_3, fire_affected_a, air_affected_a]))
distance_13 = Distance(PointA=point_16, PointB=sun)
delaunay_edges_3 = DelaunayEdges(Points=flatten(point_16), Plane=PlaneXY(0, 0, 0))  # -> Connectivity, Edges
gradient_8 = Gradient(LowerLimit="850", UpperLimit="1150", Parameter=distance_13, stops=[0.151: RGB(255, 128, 255), 0.851: RGB(128, 0, 128)])
delaunay_mesh_2 = DelaunayMesh(Points=point_16, Plane=PlaneXY(0, 0, 0))
gradient_9 = Gradient(LowerLimit="850", UpperLimit="1150", Parameter=distance_13, stops=[0.151: RGB(255, 128, 255), 0.851: RGB(128, 0, 128)])
create_material_3 = CreateMaterial(Diffuse=gradient_8, Specular=RGB(255, 255, 255), Emission=RGB(0, 0, 0), Transparency=Slider(0.88, range=0..1), Shine=0)
custom_preview_8 = CustomPreview(Geometry=delaunay_mesh_2, Material=create_material_3)
custom_preview_9 = CustomPreview(Geometry=delaunay_edges_3.Edges, Material=gradient_9)
dot_display_3 = DotDisplay(Point=point_16, Colour=ColourSwatch(SwatchColor=RGB(255, 255, 255)), Size=number_slider_11)

distance_14 = Distance(PointA=water_affected_a, PointB=sun)
remap_numbers_13 = RemapNumbers(Value=distance_14, Source="[850,1150]", Target="[6,15]")  # -> Mapped, Clipped
sphere_8 = Sphere(Base=water_affected_a, Radius=remap_numbers_13.Mapped)

brep_5 = Brep(graft(sphere_8))

gradient_10 = Gradient(LowerLimit=expr("0", 0), UpperLimit=40, Parameter=distance_12, stops=[0: RGB(255, 255, 255), 1: RGB(192, 255, 255)])

bounding_box = BoundingBox(Content=brep_5, Plane=PlaneXY(0, 0, 0))  # -> Box, Box_2
populate_3d_6 = Populate3D(Region=brep_5, Count=Slider(44, range=0..100), Seed=Slider(13, range=0..100))
pull_point = PullPoint(Point=populate_3d_6, Geometry=brep_5, ClosestOnly=True)  # -> ClosestPoint, Distance
facet_dome = FacetDome(Points=pull_point.ClosestPoint, Box=bounding_box.Box)  # -> Pattern, Dome
boundary_surfaces = BoundarySurfaces(Edges=facet_dome.Pattern)
amplitude = Amplitude(Vector=boundary_surfaces, Amplitude=expr("x", remap_numbers_12.Mapped))
move_9 = Move(Geometry=facet_dome.Pattern, Motion=amplitude)  # -> Geometry, Transform
amplitude_2 = Amplitude(Vector=boundary_surfaces, Amplitude=expr("3*x", remap_numbers_12.Mapped))
polygon_center = PolygonCenter(Polyline=move_9.Geometry)  # -> CenterV, CenterE, CenterA
scale_2 = Scale(Geometry=move_9.Geometry, Center=polygon_center.CenterV, Factor=Slider(1.02, range=0..2))  # -> Geometry, Transform
move_10 = Move(Geometry=polygon_center.CenterV, Motion=amplitude_2)  # -> Geometry, Transform
merge = Merge(Data1=graft(facet_dome.Pattern), Data2=graft(scale_2.Geometry))
extrude_point = ExtrudePoint(Base=scale_2.Geometry, Point=move_10.Geometry)
loft = Loft(Curves=merge, Options={Adjust=False, Closed=False, LoftEnds=0, LoftSimp=0, LoftType=0, Rebuild=10, Refit=0.01})
brep_join = BrepJoin(Breps=flatten([extrude_point, loft]))  # -> Breps, Closed
custom_preview_10 = CustomPreview(Geometry=brep_join.Breps, Material=gradient_10)

plane_3pt_4 = Plane3Pt(PointA=earth_affected_a_2, PointB=sun, PointC=point_16)
spin_force = SpinForce(Plane=plane_3pt_4, Strength=1, Radius=5, Decay=2)
sphere_9 = Sphere(Base=point_16, Radius=remap_numbers_11.Mapped)
merge_fields = MergeFields(Fields=spin_force)
custom_preview_11 = CustomPreview(Geometry=sphere_6, Material=gradient_7)

populate_geometry_4 = PopulateGeometry(Geometry=sphere_9, Count=Slider(10, range=0..100), Seed=1)

field_line = FieldLine(Field=merge_fields, Point=populate_geometry_4, Steps=Slider(1000, range=500..2000), Accuracy=0.1, Method=3)
cevreleyen_fıeld_lınelar = CustomPreview(Geometry=field_line, Material=ColourSwatch(SwatchColor=RGB(255, 255, 255)))

# ----
# -AIR-WATER
air_effected_w = Point(ghpython_script.air_effected_w)

distance_15 = Distance(PointA=air_effected_w, PointB=sun)
remap_numbers_14 = RemapNumbers(Value=distance_15, Source="[850,1150]", Target="[6,15]")  # -> Mapped, Clipped

point_17 = Point(flatten([fire_effected_w, air_effected_w]))
ghpython_script_5 = GhPythonScript(affected_lists_pos=point_6, affected_lists_neg=point_17)  # -> out, r_current; inputs affected_lists_pos: list, affected_lists_neg: list; same code as ghpython_script_4

# ----
# WATER ATT
sphere_10 = Sphere(Base=att_water, Radius=ghpython_script_5.r_current)
populate_3d_7 = Populate3D(Region=sphere_10, Count=expr("4*x", ghpython_script_5.r_current), Seed=Slider(4, range=0..10))
point_in_breps_2 = PointInBreps(Brep=sphere_10, Point=populate_3d_7, Strict=False)  # -> Inside, Index
distance_16 = Distance(PointA=att_water)
cull_pattern_6 = CullPattern(List=populate_3d_7, CullPattern=point_in_breps_2.Inside)
metaball_t_2 = MetaBallT(Points=flatten(cull_pattern_6), Plane=[mirror.Geometry, move_5.Geometry], Threshold=Slider(0.3, range=0..1))
length_2 = Length(Curve=metaball_t_2)
bounds_2 = Bounds(Numbers=length_2)
remap_numbers_15 = RemapNumbers(Value=length_2, Source=bounds_2, Target=Domain(0, 1))  # -> Mapped, Clipped
gradient_11 = Gradient(
    LowerLimit=0,
    UpperLimit=1,
    Parameter=remap_numbers_15.Mapped,
    stops=[0.149: RGB(192, 255, 255), 0.848: RGB(0, 128, 128)])
custom_preview_12 = CustomPreview(Geometry=metaball_t_2, Material=gradient_11)
dot_display_4 = DotDisplay(Point=cull_pattern_6, Colour=ColourSwatch(SwatchColor=RGB(255, 255, 255)), Size=Slider(0.8, range=0..1))

panel_4 = Panel(ghpython_script_5.r_current)

sphere_11 = Sphere(Base=air_effected_w, Radius=remap_numbers_14.Mapped)
populate_geometry_5 = PopulateGeometry(Geometry=sphere_11, Count=Slider(8, range=0..10), Seed=1)  # -> flatten(Population)
distance_17 = Distance(PointA=populate_geometry_5, PointB=att_water)
remap_numbers_16 = RemapNumbers(Value=distance_17, Source="[0,40]", Target="[10,3]")  # -> Mapped, Clipped
sphere_12 = Sphere(Base=populate_geometry_5, Radius=expr("x/4", remap_numbers_16.Mapped))
brep_6 = Brep(graft(sphere_12))
gradient_12 = Gradient(LowerLimit=expr("0", 0), UpperLimit=40, Parameter=distance_17, stops=[0.343: RGB(255, 255, 255), 1: RGB(192, 192, 255)])

bounding_box_2 = BoundingBox(Content=brep_6, Plane=PlaneXY(0, 0, 0))  # -> Box, Box_2
populate_3d_8 = Populate3D(Region=brep_6, Count=Slider(40, range=0..100), Seed=Slider(13, range=0..100))
pull_point_2 = PullPoint(Point=populate_3d_8, Geometry=brep_6, ClosestOnly=True)  # -> ClosestPoint, Distance
facet_dome_2 = FacetDome(Points=pull_point_2.ClosestPoint, Box=bounding_box_2.Box)  # -> Pattern, Dome
boundary_surfaces_2 = BoundarySurfaces(Edges=facet_dome_2.Pattern)
amplitude_3 = Amplitude(Vector=boundary_surfaces_2, Amplitude=expr("x/8", remap_numbers_14.Mapped))
amplitude_4 = Amplitude(Vector=boundary_surfaces_2, Amplitude=expr("x/4", remap_numbers_14.Mapped))
move_11 = Move(Geometry=facet_dome_2.Pattern, Motion=amplitude_3)  # -> Geometry, Transform
polygon_center_2 = PolygonCenter(Polyline=move_11.Geometry)  # -> CenterV, CenterE, CenterA
move_12 = Move(Geometry=polygon_center_2.CenterV, Motion=amplitude_4)  # -> Geometry, Transform
scale_3 = Scale(Geometry=move_11.Geometry, Center=polygon_center_2.CenterV, Factor=Slider(1.02, range=0..2))  # -> Geometry, Transform
merge_2 = Merge(Data1=graft(facet_dome_2.Pattern), Data2=graft(scale_3.Geometry))
extrude_point_2 = ExtrudePoint(Base=scale_3.Geometry, Point=move_12.Geometry)
loft_2 = Loft(Curves=merge_2, Options={Adjust=False, Closed=False, LoftEnds=0, LoftSimp=0, LoftType=0, Rebuild=10, Refit=0.01})
brep_join_2 = BrepJoin(Breps=flatten([extrude_point_2, loft_2]))  # -> Breps, Closed

custom_preview_13 = CustomPreview(Geometry=brep_join_2.Breps, Material=gradient_12)

# ----
# AIR-water
distance_18 = Distance(PointA=fire_effected_w, PointB=sun)
remap_numbers_17 = RemapNumbers(Value=distance_18, Source="[850,1150]", Target="[9,22.5]")  # -> Mapped, Clipped
point_charge_maın_fire_3 = PointCharge(Point=graft(fire_effected_w), Radius=remap_numbers_17.Mapped, ChargeStrength=Slider(0.3, range=0..1))
cocoon_2 = Cocoon(
    Charges=flatten(point_charge_maın_fire_3),
    Iso=Slider(0.17, range=0..1),
    CellSize=Slider(8, range=0..10),
    Execute=True,
    Simple=False)  # -> Mesh, RefinementData
gradient_13 = Gradient(LowerLimit="850", UpperLimit="1150", Parameter=distance_18, stops=[0.152: RGB(255, 192, 128), 0.854: RGB(192, 64, 0)])
create_material_4 = CreateMaterial(Diffuse=gradient_13, Specular=RGB(255, 255, 255), Emission=RGB(0, 0, 0), Transparency=Slider(0.93, range=0..1), Shine=0)
custom_preview_14 = CustomPreview(Geometry=cocoon_2.Mesh, Material=create_material_4)

mesh_plane = MeshPlane(Mesh=cocoon_2.Mesh, Plane=graft([move_6.Geometry, mirror_2.Geometry]))

curve_middle_2 = CurveMiddle(Curve=mesh_plane)
distance_19 = Distance(PointA=curve_middle_2, PointB=att_water)  # -> flatten(Distance)
gradient_14 = Gradient(
    LowerLimit=0,
    UpperLimit=100,
    Parameter=expr("x+40", distance_19),
    stops=[0.253: RGB(255, 255, 255), 0.829: RGB(255, 192, 128)])
custom_preview_15 = CustomPreview(Geometry=mesh_plane, Material=gradient_14)

brep_7 = Brep(mesh_plane)

# ----
# FIRE-earth
fire_effected_e = Point(ghpython_script.fire_effected_e)
distance_20 = Distance(PointA=fire_effected_e, PointB=sun)
gradient_15 = Gradient(LowerLimit="850", UpperLimit="1150", Parameter=distance_20, stops=[0.152: RGB(255, 192, 128), 0.854: RGB(192, 64, 0)])
create_material_5 = CreateMaterial(Diffuse=gradient_15, Specular=RGB(255, 255, 255), Emission=RGB(0, 0, 0), Transparency=Slider(0.29, range=0..1), Shine=0)
number_slider_12 = Slider(30, range=0..100)

air_effected_e = Point(ghpython_script.air_effected_e)
distance_21 = Distance(PointA=air_effected_e, PointB=sun)
remap_numbers_18 = RemapNumbers(Value=distance_21, Source="[850,1150]", Target="[6,15]")  # -> Mapped, Clipped
sphere_13 = Sphere(Base=air_effected_e, Radius=remap_numbers_18.Mapped)
populate_geometry_6 = PopulateGeometry(Geometry=sphere_13, Count=expr("3*x", remap_numbers_18.Mapped), Seed=1)
gradient_16 = Gradient(LowerLimit="850", UpperLimit="1150", Parameter=distance_21, stops=[0.151: RGB(255, 128, 255), 0.851: RGB(128, 0, 128)])
delaunay_edges_4 = DelaunayEdges(Points=flatten(populate_geometry_6), Plane=PlaneXY(0, 0, 0))  # -> Connectivity, Edges
delaunay_mesh_3 = DelaunayMesh(Points=populate_geometry_6, Plane=PlaneXY(0, 0, 0))
gradient_17 = Gradient(LowerLimit="850", UpperLimit="1150", Parameter=distance_21, stops=[0.151: RGB(255, 128, 255), 0.851: RGB(128, 0, 128)])
create_material_6 = CreateMaterial(Diffuse=gradient_16, Specular=RGB(255, 255, 255), Emission=RGB(0, 0, 0), Transparency=Slider(0.88, range=0..1), Shine=0)
dot_display_5 = DotDisplay(Point=populate_geometry_6, Colour=ColourSwatch(SwatchColor=RGB(255, 255, 255)), Size=Slider(0.8, range=0..1))
custom_preview_16 = CustomPreview(Geometry=delaunay_edges_4.Edges, Material=gradient_17)
custom_preview_17 = CustomPreview(Geometry=delaunay_mesh_3, Material=create_material_6)

point_18 = Point(flatten([air_effected_e, fire_effected_e]))
ghpython_script_6 = GhPythonScript(affected_lists_pos=point_7, affected_lists_neg=point_18)  # -> out, r_current; inputs affected_lists_pos: list, affected_lists_neg: list; same code as ghpython_script_4

# ----
# EARTH ATT
att_earth = Point(ghpython_script.att_earth)
distance_22 = Distance(PointA=att_earth, PointB=sun)
panel_5 = Panel("[6,15]")
sphere_14 = Sphere(Base=att_earth, Radius=ghpython_script_6.r_current)
gradient_18 = Gradient(LowerLimit="850", UpperLimit="1150", Parameter=distance_22, stops=[0.142: RGB(192, 255, 192), 0.85: RGB(0, 128, 0)])
custom_preview_18 = CustomPreview(Geometry=sphere_14, Material=gradient_18)

panel_6 = Panel(ghpython_script_6.r_current)
plane_3pt_5 = Plane3Pt(PointA=att_earth, PointB=sun, PointC=air_effected_e)
spin_force_2 = SpinForce(Plane=plane_3pt_5, Strength=1, Radius=5, Decay=2)
merge_fields_2 = MergeFields(Fields=spin_force_2)
curve_middle_3 = CurveMiddle(Curve=delaunay_edges_4.Edges)

plane_3pt_6 = Plane3Pt(PointA=air_effected_e, PointB=sun, PointC=att_earth)
populate_geometry_7 = PopulateGeometry(Geometry=sphere_14, Count=100, Seed=1)
spin_force_3 = SpinForce(Plane=plane_3pt_6, Strength=1, Radius=5, Decay=2)
merge_fields_3 = MergeFields(Fields=spin_force_3)
field_line_2 = FieldLine(Field=merge_fields_2, Point=curve_middle_3, Steps=Slider(1000, range=500..2000), Accuracy=0.1, Method=3)
cevreleyen_fıeld_lınelar_2 = CustomPreview(Geometry=field_line_2, Material=ColourSwatch(SwatchColor=RGB(255, 255, 255)))

distance_23 = Distance(PointA=fire_effected_e, PointB=att_earth)
remap_numbers_19 = RemapNumbers(Value=distance_23, Source="[0,40]", Target="[12,6]")  # -> Mapped, Clipped
sphere_15 = Sphere(Base=fire_effected_e, Radius=remap_numbers_19.Mapped)
sphere_16 = Sphere(Base=fire_effected_e, Radius=expr("X*2", remap_numbers_19.Mapped))
scale_4 = Scale(Geometry=sphere_15, Center=fire_effected_e, Factor=Slider(2, range=0..10))  # -> Geometry, Transform
populate_3d_9 = Populate3D(Region=scale_4.Geometry, Count=expr("x*5", remap_numbers_19.Mapped), Seed=Slider(2, range=0..10))
point_in_breps_3 = PointInBreps(Brep=scale_4.Geometry, Point=populate_3d_9, Strict=False)  # -> Inside, Index
cull_pattern_7 = CullPattern(List=populate_3d_9, CullPattern=point_in_breps_3.Inside)
gradient_19 = Gradient(
    LowerLimit=0,
    UpperLimit=expr("100", 1),
    Parameter=distance_23,
    stops=[0.225: RGB(255, 255, 255), 0.667: RGB(255, 192, 128)])
custom_preview_19 = CustomPreview(Geometry=sphere_15, Material=create_material_5)

list_item_6 = ListItem(List=flatten(populate_3d_9), Index=0, Wrap=True)  # -> Item, Item1, Item2, Item3
plane_3pt_7 = Plane3Pt(PointA=list_item_6.Item2, PointB=list_item_6.Item, PointC=sun)
deconstruct_plane_4 = DeconstructPlane(Plane=plane_3pt_7)  # -> Origin, XAxis, YAxis, ZAxis
series_5 = Series(Start=Slider(0, range=0..100), Step=Slider(1, range=0..10), Count=Slider(100, range=0..100))
unit_vector_4 = UnitVector(Vector=deconstruct_plane_4.ZAxis)
multiplication_4 = Multiplication(A=unit_vector_4, B=series_5)
move_13 = Move(Geometry=plane_3pt_7, Motion=multiplication_4)  # -> Geometry, Transform
mirror_5 = Mirror(Geometry=move_13.Geometry, Plane=plane_3pt_7)  # -> Geometry, Transform

metaball_t_3 = MetaBallT(Points=flatten(cull_pattern_7), Plane=[mirror_5.Geometry, move_13.Geometry], Threshold=Slider(0.16, range=0..1))
length_3 = Length(Curve=metaball_t_3)
bounds_3 = Bounds(Numbers=length_3)
remap_numbers_20 = RemapNumbers(Value=length_3, Source=bounds_3, Target=Domain(0, 1))  # -> Mapped, Clipped
custom_preview_20 = CustomPreview(Geometry=metaball_t_3, Material=gradient_19)

# ----
# FIRE-earth
distance_24 = Distance(PointA=earth_effected_f_2, PointB=sun)
distance_25 = Distance(PointA=earth_effected_f_2, PointB=att_fire)
panel_7 = Panel("[10,4]")
remap_numbers_21 = RemapNumbers(Value=distance_25, Source="[0,40]", Target="[12,6]")  # -> Mapped, Clipped
sphere_17 = Sphere(Base=earth_effected_f_2, Radius=remap_numbers_21.Mapped)
sphere_18 = Sphere(Base=earth_effected_f_2, Radius=expr("X*2", remap_numbers_21.Mapped))
scale_5 = Scale(Geometry=sphere_17, Center=earth_effected_f_2, Factor=Slider(2, range=0..10))  # -> Geometry, Transform
number_slider_13 = Slider(30, range=0..100)
populate_3d_10 = Populate3D(Region=scale_5.Geometry, Count=expr("x*5", remap_numbers_21.Mapped), Seed=Slider(2, range=0..10))
point_in_breps_4 = PointInBreps(Brep=scale_5.Geometry, Point=populate_3d_10, Strict=False)  # -> Inside, Index
cull_pattern_8 = CullPattern(List=populate_3d_10, CullPattern=point_in_breps_4.Inside)
gradient_20 = Gradient(LowerLimit=0, UpperLimit=expr("100", 1), Parameter=distance_25, stops=[0: RGB(255, 255, 255), 0.861: RGB(255, 192, 128)])

gradient_21 = Gradient(LowerLimit="850", UpperLimit="1150", Parameter=distance_24, stops=[0.142: RGB(192, 255, 192), 0.85: RGB(0, 128, 0)])

list_item_7 = ListItem(List=flatten(populate_3d_10), Index=0, Wrap=True)  # -> Item, Item1, Item2, Item3
plane_3pt_8 = Plane3Pt(PointA=list_item_7.Item2, PointB=list_item_7.Item, PointC=sun)
deconstruct_plane_5 = DeconstructPlane(Plane=plane_3pt_8)  # -> Origin, XAxis, YAxis, ZAxis
series_6 = Series(Start=Slider(0, range=0..100), Step=Slider(1, range=0..10), Count=Slider(100, range=0..100))
unit_vector_5 = UnitVector(Vector=deconstruct_plane_5.ZAxis)
multiplication_5 = Multiplication(A=unit_vector_5, B=series_6)
move_14 = Move(Geometry=plane_3pt_8, Motion=multiplication_5)  # -> Geometry, Transform
mirror_6 = Mirror(Geometry=move_14.Geometry, Plane=plane_3pt_8)  # -> Geometry, Transform

create_material_7 = CreateMaterial(Diffuse=gradient_21, Specular=RGB(255, 255, 255), Emission=RGB(0, 0, 0), Transparency=Slider(0.29, range=0..1), Shine=0)
metaball_t_4 = MetaBallT(Points=flatten(cull_pattern_8), Plane=[mirror_6.Geometry, move_14.Geometry], Threshold=Slider(0.16, range=0..1))
length_4 = Length(Curve=metaball_t_4)
bounds_4 = Bounds(Numbers=length_4)
remap_numbers_22 = RemapNumbers(Value=length_4, Source=bounds_4, Target=Domain(0, 1))  # -> Mapped, Clipped
custom_preview_21 = CustomPreview(Geometry=metaball_t_4, Material=gradient_20)
custom_preview_22 = CustomPreview(Geometry=sphere_17, Material=create_material_7)

# ----
# NORMAL WATER
panel_8 = Panel("[6,15]")
distance_26 = Distance(PointA=water_effected_f, PointB=sun)
remap_numbers_23 = RemapNumbers(Value=distance_26, Source="[850,1150]", Target=panel_8)  # -> Mapped, Clipped
sphere_19 = Sphere(Base=water_effected_f, Radius=remap_numbers_23.Mapped)
number_slider_14 = Slider(44, range=0..100)
number_slider_15 = Slider(4, range=0..10)
populate_3d_11 = Populate3D(Region=sphere_19, Count=expr("4*x", remap_numbers_23.Mapped), Seed=number_slider_15)
point_in_breps_5 = PointInBreps(Brep=sphere_19, Point=populate_3d_11, Strict=False)  # -> Inside, Index
cull_pattern_9 = CullPattern(List=populate_3d_11, CullPattern=point_in_breps_5.Inside)
metaball_t_5 = MetaBallT(Points=flatten(cull_pattern_9), Plane=[mirror_3.Geometry, move_7.Geometry], Threshold=Slider(0.36, range=0..1))
length_5 = Length(Curve=metaball_t_5)
bounds_5 = Bounds(Numbers=length_5)
remap_numbers_24 = RemapNumbers(Value=length_5, Source=bounds_5, Target=Domain(0, 1))  # -> Mapped, Clipped
gradient_22 = Gradient(
    LowerLimit=0,
    UpperLimit=1,
    Parameter=remap_numbers_24.Mapped,
    stops=[0.149: RGB(192, 255, 255), 0.848: RGB(0, 128, 128)])
custom_preview_23 = CustomPreview(Geometry=metaball_t_5, Material=gradient_22)

sphere_20 = Sphere(Base=water_effected_f, Radius=remap_numbers_23.Mapped)
populate_3d_12 = Populate3D(Region=sphere_20, Count=remap_numbers_3.Mapped, Seed=number_slider_15)
point_19 = Point(flatten(populate_3d_12))
delaunay_edges_5 = DelaunayEdges(Points=point_19, Plane=PlaneXY(0, 0, 0))  # -> Connectivity, Edges
multipipe = MultiPipe(
    Curves=delaunay_edges_5.Edges,
    NodeSize=Slider(0.22, range=0..1),
    EndOffset=1,
    StrutSize=1,
    Segment=0,
    KinkAngle=0.6,
    CubeFit=0,
    Caps=0)
custom_preview_24 = CustomPreview(Geometry=multipipe, Material=ColourSwatch(SwatchColor=RGB(155, 185, 189)))

dot_display_6 = DotDisplay(Point=[cull_pattern_9, point_19], Colour=ColourSwatch(SwatchColor=RGB(255, 255, 255)), Size=Slider(0.8, range=0..1))

# ----
# FIRE ATT
distance_27 = Distance(PointA=att_fire, PointB=sun)
number_slider_16 = Slider(0.6, range=0..1)
point_charge_maın_fire_4 = PointCharge(Point=graft(att_fire), Radius=ghpython_script_3.r_current, ChargeStrength=number_slider_16)
gradient_23 = Gradient(LowerLimit="850", UpperLimit="1150", Parameter=distance_27, stops=[0.152: RGB(255, 192, 128), 0.854: RGB(192, 64, 0)])
create_material_8 = CreateMaterial(Diffuse=gradient_23, Specular=RGB(255, 255, 255), Emission=RGB(0, 0, 0), Transparency=Slider(0.93, range=0..1), Shine=0)

curve_charge = CurveCharge(Curve=line, Radius=expr("x/3", ghpython_script_3.r_current), ChargeStrengths=number_slider_16)

cocoon_3 = Cocoon(
    Charges=flatten([point_charge_maın_fire_4, curve_charge]),
    Iso=Slider(0.17, range=0..1),
    CellSize=Slider(8, range=0..10),
    Execute=True,
    Simple=False)  # -> Mesh, RefinementData
populate_geometry_8 = PopulateGeometry(Geometry=cocoon_3.Mesh, Count=expr("4*x", ghpython_script_3.r_current), Seed=1)
delaunay_edges_6 = DelaunayEdges(Points=populate_geometry_8, Plane=PlaneXY(0, 0, 0))  # -> Connectivity, Edges
curve_middle_4 = CurveMiddle(Curve=delaunay_edges_6.Edges)
distance_28 = Distance(PointA=curve_middle_4, PointB=sun)
gradient_24 = Gradient(LowerLimit="850", UpperLimit="1150", Parameter=distance_28, stops=[0.152: RGB(255, 192, 128), 0.854: RGB(192, 64, 0)])
custom_preview_25 = CustomPreview(Geometry=delaunay_edges_6.Edges, Material=gradient_24)
custom_preview_26 = CustomPreview(Geometry=cocoon_3.Mesh, Material=create_material_8)
